# Grasshopper definition Timber_gridShell.gh (Grasshopper 1.0.8)
# plug-ins: CORE.Toolbox.Grasshopper, GrasshopperRfem6WsPlugin, LunchBox, Kangaroo2 Components

sectionbeamouter = ValueList({"Rect. 50 x 100": "R_M1 0.05/0.1", "Rect. 100 x 200": "R_M1 0.1/0.2", "Rect. 200 x 300": "R_M1 0.2/0.3", "Rect. 200 x 100": "R_M1 0.2/0.1", "Rect. 300 x 200": "R_M1 0.3/0.2"}, selected="Rect. 50 x 100")

# ----
# Section of beam
# Note for functioning of script: description must match name in RFEM libary
sectionbeaminner = ValueList({"Rect. 50 x 100": "R_M1 0.05/0.1", "Rect. 100 x 200": "R_M1 0.1/0.2", "Rect. 200 x 300": "R_M1 0.2/0.3", "Rect. 200 x 100": "R_M1 0.2/0.1"}, selected="Rect. 50 x 100")
sectionbeaminner_2 = Text(sectionbeaminner)
sectionbeamouter_2 = Text(sectionbeamouter)

# ----
# Timber
# Note for functioning of script: description must match name in RFEM libary
materialsectioninner = ValueList({"GL20c", "GL22c", "GL24c", "GL26c", "GL28c", "GL30c", "GL32c", "C14", "C16", "C18", "C20", "C22", "C24", "C27", "C30", "C35", "C40", "C45", "C50"}, selected="C24")
materialsectionouter = ValueList({"GL20c", "GL22c", "GL24c", "GL26c", "GL28c", "GL30c", "GL32c", "C14", "C16", "C18", "C20", "C22", "C24", "C27", "C30", "C35", "C40", "C45", "C50"}, selected="C24")
materialsectioninner_2 = Text(materialsectioninner)
materialsectionouter_2 = Text(materialsectionouter)

sectionbeamouter_3 = Text(sectionbeamouter_2)
materialsection2 = Text(materialsectionouter_2)
sectionbeaminner_3 = Text(sectionbeaminner_2)
materialsection1 = Text(materialsectioninner_2)

# ----
# RFEM settings
# Name of the RFEM model
# Export the model
# Run the calculations
# Export results from RFEM to CSV file (This takes several minutes!!!)
runcalculationsrfem = Button()
exporttocsv = Button()
namemodelrfem = Panel("Shell structure v3")
runcalculationsrfem_2 = Boolean(runcalculationsrfem)
namemodelrfem_2 = Text(namemodelrfem)
exporttorfem = Boolean(Toggle(False))
exporttocsv_2 = Boolean(exporttocsv)

crv = Curve(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)

materialsectioninner_3 = Text(materialsection1)
materialsectionouter_3 = Text(materialsection2)
# Materials
# Creating materials for structural model
panel = Panel("Input")

materialsectionouter_4 = Text(materialsectionouter_3)

panel_2 = Panel("Setup material outer")
material = Material(MaterialNo="2", MaterialName=materialsectionouter_4, mode="Assemble")
materialouterrfem = Data(material)

materialouterrfem_2 = Data(materialouterrfem)
materialsectioninner_4 = Text(materialsectioninner_3)

panel_3 = Panel("Setup material inner")
material_2 = Material(MaterialNo="1", MaterialName=materialsectioninner_4, mode="Assemble")
materialinnerrfem = Data(material_2)

materialinnerrfem_2 = Data(materialinnerrfem)

# ----
# Merge materials in one list
# Note: this become relevant when there is
# more than one material used in the model.
merge = Merge(Data1=materialinnerrfem_2, Data2=materialouterrfem_2)
materialsrfem = Data(merge)

panel_4 = Panel("Output")
materialsrfem_2 = Data(materialsrfem)

sectionbeamouter_4 = Text(sectionbeamouter_3)
sectionbeaminner_4 = Text(sectionbeaminner_3)
# Sections
# Creating sections for structural model
panel_5 = Panel("Input")
materialrfem = Data(materialsrfem)

sectionbeamouter_5 = Text(sectionbeamouter_4)
sectionbeaminner_5 = Text(sectionbeaminner_4)

panel_6 = Panel("Setup a section Inner")
material_no = Integer("1")
integer = Integer("1")
name = Text(sectionbeaminner_5)
section = Section(SectionNo=integer, SectionName=name, MaterialNo=material_no, mode="Assemble")
sectioninnerrfem = Data(section)

sectioninnerrfem_2 = Data(section)

panel_7 = Panel("Setup a section Outer")
material_no_2 = Integer("2")
integer_2 = Integer("2")
name_2 = Text(sectionbeamouter_5)
section_2 = Section(SectionNo=integer_2, SectionName=name_2, MaterialNo=material_no_2, mode="Assemble")
sectionouterrfem = Data(section_2)

sectionouterrfem_2 = Data(section_2)

# ----
# Merge section in one list
merge_2 = Merge(Data1=sectioninnerrfem_2, Data2=sectionouterrfem_2)
sectionrfem = Data(merge_2)

sectionouterrfem_3 = Data(section_2)
sectioninnerrfem_3 = Data(section)
sectionrfem_2 = Data(sectionrfem)

# ----
# Shape structure
number_slider = Slider(3, range=0..10)
recgrid = Rectangular(Plane=PlaneXY(0, 0, 0), SizeX="6.133333", SizeY="5.5", ExtentX=Slider(3, range=0..10), ExtentY=number_slider)  # -> Cells, simplify(Points)
pt = Point(recgrid.Points)
cir = Circle(Plane=recgrid.Points, Radius=Slider(0.4, range=0..1))
panel_9 = Panel("""0
-1""")
panel_10 = Panel("""1
-2""")
item = ListItem(List=pt, Index=panel_9, Wrap=True)
flip = FlipMatrix(Data=item)
item_2 = ListItem(List=flip, Index=panel_10, Wrap=True)
dispatch = Dispatch(List=item_2, DispatchPattern=[True, False])  # -> ListA, ListB
srfgrid = SurfaceFromPoints(Points=flatten(item_2), UCount=Slider(2, range=0..2), Interpolate=False)
debrep = DeconstructBrep(Brep=srfgrid)  # -> Faces, Edges, Vertices
dispatch_2 = Dispatch(List=debrep.Edges, DispatchPattern=[True, False])  # -> ListA, ListB
area = Area(Geometry=srfgrid)  # -> Area, Centroid
midpt = CurveMiddle(Curve=dispatch_2.ListB)
vec2pt = Vector2Pt(PointA=midpt, PointB=area.Centroid, Unitize=False)  # -> Vector, Length
multiplication = Multiplication(A=vec2pt.Vector, B=Slider(0.2, range=0..1))
cir_2 = Circle(Plane=area.Centroid, Radius=Slider(1.5, range=0..5))
midpt_2 = CurveMiddle(Curve=dispatch_2.ListA)
move = Move(Geometry=midpt, Motion=multiplication)  # -> Geometry, Transform
weave = Weave(Pattern=[0, 1], Stream0=midpt_2, Stream1=move.Geometry, NullGaps=False)
boundary = BoundarySurfaces(Edges=cir_2)
weave_2 = Weave(Pattern=[0, 1], Stream0=debrep.Vertices, Stream1=weave, NullGaps=False)
pline = PolyLine(Vertices=weave_2, Closed=True)
rdiff = RegionDifference(CurvesA=pline, CurvesB=boundary)
qrsettings = QuadRemeshSettings(
    TargetCount=Slider(300, range=0..1000),
    AdaptiveSize=0,
    AdaptiveCount=True,
    HardEdges=False,
    SeamEdges=0,
    Symmetry=0,
    GuideCurves=0)
boundary_2 = BoundarySurfaces(Edges=rdiff)
qrmesh = QuadRemesh(Mesh=boundary_2, Settings=qrsettings)
area_2 = Area(Geometry=boundary_2)  # -> Area, Centroid
nv = NakedVertices(Mesh=qrmesh)  # -> ClothedIndex, NakedIndex, ClothedPts, NakedPts
pt_2 = Point(nv.NakedPts)
dist = Distance(PointA=area_2.Centroid, PointB=pt_2)
edgelengths = EdgeLengths(Mesh=qrmesh, LengthFactor=Slider(1, range=0..1), Strength=Slider(256, range=0..500))
larger = LargerThan(FirstNumber=dist, SecondNumber=Slider(7.7, range=0..20))  # -> LargerThan, OrEqualTo
show = Show(G=qrmesh)
Z = UnitZ(Factor=Slider(1, range=0..1))
cull = CullPattern(List=pt_2, CullPattern=larger.LargerThan)
cps = ClosestPoints(Point=dispatch.ListA, Cloud=cull, Count=3)  # -> simplify(ClosestPoint), CPIndex, Distance
cps_2 = ClosestPoints(Point=dispatch.ListB, Cloud=cull, Count=3)  # -> ClosestPoint, CPIndex, Distance
load = Load(Point=nv.ClothedPts, ForceVector=Z, Weighting=Slider(2, range=0..10))
Z_2 = UnitZ(Factor=Slider(0, range=0..10))
number_slider_2 = Slider(1000, range=0..1000)
move_2 = Move(Geometry=cps.ClosestPoint, Motion=Z_2)  # -> Geometry, Transform
anchor = Anchor(Point=simplify(cps_2.ClosestPoint), Strength=number_slider_2)
anchor_2 = Anchor(Point=cps.ClosestPoint, Target=move_2.Geometry, Strength=number_slider_2)
solver = Solver(
    GoalObjects=[edgelengths, show, anchor, load, anchor_2],
    Reset=Button(),
    Threshold=1e-15,
    Tolerance=0.0001,
    On=Toggle(True))  # -> I, V, O
branch = TreeBranch(Tree=solver.O, Path="{0;0;0}", MaintainPaths=True)
medges = MeshEdges(Mesh=branch)  # -> NakedEdges, InteriorEdges, NonManifoldEdges
area_3 = Area(Geometry=branch)  # -> Area, Centroid
demesh = DeconstructMesh(Mesh=branch)  # -> Vertices, Faces, Colours, Normals
innerlines = Curve(medges.InteriorEdges)
outerlines = Curve(medges.NakedEdges)
midpt_3 = CurveMiddle(Curve=outerlines)
dist_2 = Distance(PointA=area_3.Centroid, PointB=midpt_3)
larger_2 = LargerThan(FirstNumber=dist_2, SecondNumber=Slider(8.34, range=7.5..10))  # -> LargerThan, OrEqualTo
cull_2 = CullPattern(List=outerlines, CullPattern=larger_2.LargerThan)
end = EndPoints(Curve=cull_2)  # -> Start, End
merge_3 = Merge(Data1=end.Start, Data2=end.End)
cullpt = CullDuplicates(Points=merge_3, Tolerance=0.1, CullMode=3)  # -> Points, Indices, Valence
supportpoints = Point(cullpt.Points)
relay = Relay([outerlines, innerlines])
sph = Sphere(Base=supportpoints, Radius=Slider(0.2, range=0..1))
pipe = Pipe(Curve=relay, Radius=Slider(0.05, range=0..0.1), Caps=0)
bake = ObjectBake(
    BakeToggle=Button(),
    GeometryObjects=sph,
    Layer="supports",
    ObjectName="GH_Obj",
    ObjectColor=RGB(255, 255, 255),
    LayerColor=RGB(255, 255, 255))
bake_2 = ObjectBake(
    BakeToggle=Button(),
    GeometryObjects=pipe,
    Layer="structure",
    ObjectName="GH_Obj",
    ObjectColor=RGB(255, 255, 255),
    LayerColor=RGB(255, 255, 255))
len = Length(Curve=relay)
avr = Average(Input=len)
average_length = Number(avr)

# ----
# Polycarbonate sheet load [N/m2]
# Wind loading [N/m2]
# Snow load [N/m2]
windload = Slider(1120, range=0..1500)
average_length_2 = Number(average_length)
snowload = Slider(560, range=0..1000)
average_length_3 = Number(average_length)
sheetload = Slider(120, range=0..1000)
average_length_4 = Number(average_length)
expression = Expression(q=snowload, n=average_length_2, Expression="0.5*n*q")
expression_2 = Expression(q=sheetload, n=average_length_3, Expression="0.5*n*q")
expression_3 = Expression(q=windload, n=average_length_4, Expression="0.5*n*q")
sheetload_2 = Number(expression_2)
snowload_2 = Number(expression)
windloading = Number(expression_3)

# ----
# Geometry of the shell structure
# outerBeams
# Inner beams
# Support curves of the shell
supportpts = Point(supportpoints)
supportpts_2 = Point(supportpts)

# ----
# Parameters
# Configuration of model
outerlines_2 = Curve(outerlines)
innerlines_2 = Curve(innerlines)

runcalculationsrfem_3 = Boolean(runcalculationsrfem_2)
namemodelrfem_3 = Text(namemodelrfem_2)
exporttorfem_2 = Boolean(exporttorfem)
supportpts_3 = Point(supportpts_2)
windloading_2 = Number(windloading)
exporttocsv_3 = Boolean(exporttocsv_2)

snowload_3 = Number(snowload_2)
sheetload_3 = Number(sheetload_2)
innerlines_3 = Curve(innerlines_2)
innerlines_4 = Curve(innerlines_3)
sort_crv = SortByCurve(Curves=innerlines_4, Guide=crv, Parameter=0.5)  # -> simplify(Curves), Indices
outerlines_3 = Curve(outerlines_2)
outerlines_4 = Curve(outerlines_3)
sort_crv_2 = SortByCurve(Curves=outerlines_4, Guide=crv, Parameter=0.5)  # -> simplify(Curves), Indices

innerlines_5 = Curve(sort_crv.Curves)
outerlines_5 = Curve(sort_crv_2.Curves)

outerlines_6 = Curve(outerlines_5)
innerlines_6 = Curve(innerlines_5)
# Members
# Creating members for structural model
panel_12 = Panel("Input")
sectionsrfem = Data(sectionrfem_2)
innerlines_7 = Curve(innerlines_6)

# ----
# Setup a member for the inner beams
# This is used for automatic numbering of
# members. When the parameters are changed,
# also the number of members change.
sectionsrfem_2 = Data(sectionsrfem)
list = ValueList({"TYPE_BEAM": 0, "TYPE_BUCKLING": 1, "TYPE_CABLE": 2, "TYPE_COMPRESSION": 3, "TYPE_COUPLING_HINGE_HINGE": 4, "TYPE_COUPLING_HINGE_RIGID": 5, "TYPE_COUPLING_RIGID_HINGE": 6, "TYPE_COUPLING_RIGID_RIGID": 7, "TYPE_DAMPER": 8, "TYPE_DEFINABLE_STIFFNESS": 9, "TYPE_JOIST": 10, "TYPE_RESULT_BEAM": 11, "TYPE_RIB": 12, "TYPE_RIGID": 13, "TYPE_SPRING": 14, "TYPE_SURFACE_MODEL": 15, "TYPE_TENSION": 16, "TYPE_TRUSS": 17, "TYPE_TRUSS_ONLY_N": 18}, selected="TYPE_BEAM")
lng = ListLength(List=innerlines_7)
series = Series(Start="1", Step=1, Count=lng)
item_3 = ListItem(List=sectionsrfem_2, Index="0", Wrap=True)
sec_start = Integer(item_3)
integer_3 = Integer(series)
gh_line = Geometry(innerlines_7)
type = Integer(list)
member = Member(GHLine=gh_line, MemberNo=integer_3, SectionStart=sec_start, MemberType=type, mode="Assemble")  # -> simplify(flatten(Member))
item_4 = ListItem(List=series, Index=0, Wrap=True)  # -> flatten(Item1), Item
memberinnerbeamsrfem = Data(member)
membercounter_1 = Integer(item_4.Item1)

panel_13 = Panel("""0
0
0
0
1""")
outerlines_7 = Curve(outerlines_6)

# ----
# Setup a member for the outer beams
membercounter_1_2 = Integer(membercounter_1)
sectionsrfem_3 = Data(sectionsrfem)
list_2 = ValueList({"TYPE_BEAM": 0, "TYPE_BUCKLING": 1, "TYPE_CABLE": 2, "TYPE_COMPRESSION": 3, "TYPE_COUPLING_HINGE_HINGE": 4, "TYPE_COUPLING_HINGE_RIGID": 5, "TYPE_COUPLING_RIGID_HINGE": 6, "TYPE_COUPLING_RIGID_RIGID": 7, "TYPE_DAMPER": 8, "TYPE_DEFINABLE_STIFFNESS": 9, "TYPE_JOIST": 10, "TYPE_RESULT_BEAM": 11, "TYPE_RIB": 12, "TYPE_RIGID": 13, "TYPE_SPRING": 14, "TYPE_SURFACE_MODEL": 15, "TYPE_TENSION": 16, "TYPE_TRUSS": 17, "TYPE_TRUSS_ONLY_N": 18}, selected="TYPE_BEAM")
expression_4 = Expression(x=membercounter_1_2, Expression="x+1")
lng_2 = ListLength(List=outerlines_7)
series_2 = Series(Start=expression_4, Step=1, Count=lng_2)
item_5 = ListItem(List=sectionsrfem_3, Index="1", Wrap=True)
sec_start_2 = Integer(item_5)
gh_line_2 = Geometry(outerlines_7)
integer_4 = Integer(series_2)
type_2 = Integer(list_2)
member_2 = Member(GHLine=gh_line_2, MemberNo=integer_4, SectionStart=sec_start_2, MemberType=type_2, mode="Assemble")  # -> flatten(Member)
item_6 = ListItem(List=series_2, Index=0, Wrap=True)  # -> flatten(Item1), Item
memberouterbeamsrfem = Data(member_2)
membercounter_2 = Integer(item_6.Item1)

# ----
# Supports
panel_14 = Panel("Input")
supportpts_4 = Point(supportpts_3)

supportpts_5 = Point(supportpts_4)

# ----
# Setup a support condition for the corners
list_3 = ValueList({"INF"}, selected="INF")
nodal_support = NodalSupport(
    GHNode=supportpts_5,
    TranslationalSpringX=list_3,
    TranslationalSpringY=list_3,
    TranslationalSpringZ=list_3,
    mode="Assemble")
supportcurvesrfem = Data(nodal_support)

# ----
# Merge the data for supports
supportcurvesrfem_2 = Data(supportcurvesrfem)
merge_4 = Merge(Data1=supportcurvesrfem_2)
supportsrfem = Data(merge_4)

supportsrfem_2 = Data(supportsrfem)

panel_16 = Panel("Setup analysis settings")
list_4 = ValueList({"GEOMETRICALLY_LINEAR": 0, "LARGE_DEFORMATIONS": 1, "SECOND_ORDER_P_DELTA": 2}, selected="GEOMETRICALLY_LINEAR")
static_analysis_settings = StaticAnalysisSettings(StaticAnalysisSettingNo="1", AnalysisType=list_4, mode="Assemble")
analysissettingsrfem = Data(static_analysis_settings)

analysissettingsrfem_2 = Data(analysissettingsrfem)

load_case_classification_component = LoadCaseClassificationComponent(ActionIndex=0, DesignIndex=13, StandardIndex=0, menu=[dropdown(0), dropdown(0), dropdown(13)])  # -> ActionCategory, DesignSituationType
load_case_classification_component_2 = LoadCaseClassificationComponent(ActionIndex=0, DesignIndex=3, StandardIndex=0, menu=[dropdown(0), dropdown(0), dropdown(3)])  # -> ActionCategory, DesignSituationType
panel_18 = Panel("Setup design situations")
design_situation = DesignSituation(
    ObjectNumber="1",
    DesignSituationName="ULS",
    DesignSituationType=load_case_classification_component.DesignSituationType,
    mode="Assemble")
design_situation_2 = DesignSituation(
    ObjectNumber="2",
    DesignSituationName="SLS",
    DesignSituationType=load_case_classification_component_2.DesignSituationType,
    mode="Assemble")
designsituationulsrfem = Data(design_situation)
designsituationslsrfem = Data(design_situation_2)

# ----
# Merge the data for design situation
designsituationslsrfem_2 = Data(designsituationslsrfem)
designsituationulsrfem_2 = Data(designsituationulsrfem)
merge_5 = Merge(Data1=designsituationulsrfem_2, Data2=designsituationslsrfem_2)
designsituationrfem = Data(merge_5)

designsituationrfem_2 = Data(designsituationrfem)

panel_20 = Panel("Input")
analysissettingsrfem_3 = Data(analysissettingsrfem_2)

panel_21 = Panel("Setup load combinations")
analysissettingsrfem_4 = Data(analysissettingsrfem_3)
co3_sls = Panel("""1
2""")
co4_sls = Panel("""1
3""")
co2_uls = Panel("""1.2
1.50""")
co2_uls_2 = Panel("""1
3""")
co1_uls = Panel("""1.2
1.50""")
co1_uls_2 = Panel("""1
2""")
co4_sls_2 = Panel("""1.00
1.00""")
co3_sls_2 = Panel("""1.00
1.00""")
entwine = Entwine(Branch00=co1_uls_2, Branch01=co2_uls_2, Branch02=co3_sls, Branch03=co4_sls, FlattenInputs=True)
entwine_2 = Entwine(Branch00=co1_uls, Branch01=co2_uls, Branch02=co3_sls_2, Branch03=co4_sls_2, FlattenInputs=True)
panel_22 = Panel("""ULS 6.10a: Combined loads; yG = 1.35; yQ = 1.50
ULS 6.10b: Combined loads; yG = 1.25; yQ = 1.50
SLS: Combined loads; yG = 1.00; yQ = 1.00
SLS: Combined loads; yG = 1.00; yQ = 1.00""")
load_combination_items = LoadCombinationItems(LoadCaseNo=entwine, Factor=entwine_2, mode="Assemble")
panel_23 = Panel("""1
2
3
4""")
panel_24 = Panel("""CO1 ULS
CO2 ULS
CO3 SLS
CO4 SLS""")
panel_25 = Panel("""1
1
2
2""")
load_combination = LoadCombination(
    LoadCombinationNo=graft(panel_23),
    LoadCombinationName=graft(panel_24),
    Items=load_combination_items,
    StaticAnalysisSettingsNo=analysissettingsrfem_4,
    DesignSituationNo=graft(panel_25),
    Comment=graft(panel_22),
    mode="Assemble")
loadcombinationsrfem = Data(load_combination)

loadcombinationsrfem_2 = Data(loadcombinationsrfem)

panel_27 = Panel(loadcombinationsrfem)

analysissettingsrfem_5 = Data(analysissettingsrfem_2)

# ----
# Create load case self weight
load_case_classification_component_3 = LoadCaseClassificationComponent(ActionIndex=0, DesignIndex=13, StandardIndex=0, menu=[dropdown(0), dropdown(0), dropdown(13)])  # -> ActionCategory, DesignSituationType
analysissettingsrfem_6 = Data(analysissettingsrfem_5)
load_case = LoadCase(
    LoadCaseNo="1",
    LoadCaseName="Self weight",
    StaticAnalysisSettings=analysissettingsrfem_6,
    ActionCategory=load_case_classification_component_3.ActionCategory,
    SelfWeightActive=Toggle(True),
    mode="Assemble")
loadcase1rfem = Data(load_case)

# ----
# Create load case for wind loading
load_case_classification_component_4 = LoadCaseClassificationComponent(ActionIndex=26, DesignIndex=13, StandardIndex=0, menu=[dropdown(0), dropdown(26), dropdown(13)])  # -> ActionCategory, DesignSituationType
analysissettingsrfem_7 = Data(analysissettingsrfem_5)
load_case_2 = LoadCase(
    LoadCaseNo="2",
    LoadCaseName="Wind",
    StaticAnalysisSettings=analysissettingsrfem_7,
    ActionCategory=load_case_classification_component_4.ActionCategory,
    SelfWeightActive=Toggle(False),
    mode="Assemble")
loadcase2rfem = Data(load_case_2)

# ----
# Create load case for snow loading
load_case_classification_component_5 = LoadCaseClassificationComponent(ActionIndex=20, DesignIndex=13, StandardIndex=0, menu=[dropdown(0), dropdown(20), dropdown(13)])  # -> ActionCategory, DesignSituationType
analysissettingsrfem_8 = Data(analysissettingsrfem_5)
load_case_3 = LoadCase(
    LoadCaseNo="3",
    LoadCaseName="Snow",
    StaticAnalysisSettings=analysissettingsrfem_8,
    ActionCategory=load_case_classification_component_5.ActionCategory,
    SelfWeightActive=Toggle(False),
    mode="Assemble")
loadcase3rfem = Data(load_case_3)

loadcase3rfem_2 = Data(loadcase3rfem)

# ----
# Merge the data for load cases
loadcase2rfem_2 = Data(loadcase2rfem)
loadcase1rfem_2 = Data(loadcase1rfem)
merge_6 = Merge(Data1=loadcase1rfem_2, Data2=loadcase2rfem_2, Data3=loadcase3rfem_2)
loadcasesrfem = Data(merge_6)

loadcasesrfem_2 = Data(loadcasesrfem)

loadcasesrfem_3 = Data(loadcasesrfem_2)
windloading_3 = Number(windloading_2)
innerlines_8 = Curve(innerlines_5)
outerlines_8 = Curve(outerlines_5)

innerlines_9 = Curve(innerlines_8)
panel_31 = Panel("""0
0
0
0
1""")
lng_3 = ListLength(List=innerlines_9)
list_5 = ValueList({"E_TYPE_MASS": 0, "LOAD_TYPE_AXIAL_DISPLACEMENT": 1, "LOAD_TYPE_AXIAL_STRAIN": 2, "LOAD_TYPE_COATING_CONTOUR": 3, "LOAD_TYPE_COATING_POLYGON": 4, "LOAD_TYPE_DISPLACEMENT": 5, "LOAD_TYPE_END_PRESTRESS": 6, "LOAD_TYPE_FORCE": 7, "LOAD_TYPE_FORM_FINDING": 8, "LOAD_TYPE_INITIAL_PRESTRESS": 9, "LOAD_TYPE_MOMENT": 10, "LOAD_TYPE_PIPE_CONTENT_FULL": 11, "LOAD_TYPE_PIPE_CONTENT_PARTIAL": 12, "LOAD_TYPE_PIPE_INTERNAL_PRESSURE": 13, "LOAD_TYPE_PRECAMBER": 14, "LOAD_TYPE_ROTARY_MOTION": 15, "LOAD_TYPE_ROTATION": 16, "LOAD_TYPE_TEMPERATURE": 17, "LOAD_TYPE_TEMPERATURE_CHANGE": 18}, selected="E_TYPE_MASS")
list_6 = ValueList({"E_TYPE_MASS": 0, "LOAD_TYPE_AXIAL_DISPLACEMENT": 1, "LOAD_TYPE_AXIAL_STRAIN": 2, "LOAD_TYPE_COATING_CONTOUR": 3, "LOAD_TYPE_COATING_POLYGON": 4, "LOAD_TYPE_DISPLACEMENT": 5, "LOAD_TYPE_END_PRESTRESS": 6, "LOAD_TYPE_FORCE": 7, "LOAD_TYPE_FORM_FINDING": 8, "LOAD_TYPE_INITIAL_PRESTRESS": 9, "LOAD_TYPE_MOMENT": 10, "LOAD_TYPE_PIPE_CONTENT_FULL": 11, "LOAD_TYPE_PIPE_CONTENT_PARTIAL": 12, "LOAD_TYPE_PIPE_INTERNAL_PRESSURE": 13, "LOAD_TYPE_PRECAMBER": 14, "LOAD_TYPE_ROTARY_MOTION": 15, "LOAD_TYPE_ROTATION": 16, "LOAD_TYPE_TEMPERATURE": 17, "LOAD_TYPE_TEMPERATURE_CHANGE": 18}, selected="E_TYPE_MASS")
list_7 = ValueList({"E_TYPE_MASS": 0, "LOAD_TYPE_AXIAL_DISPLACEMENT": 1, "LOAD_TYPE_AXIAL_STRAIN": 2, "LOAD_TYPE_COATING_CONTOUR": 3, "LOAD_TYPE_COATING_POLYGON": 4, "LOAD_TYPE_DISPLACEMENT": 5, "LOAD_TYPE_END_PRESTRESS": 6, "LOAD_TYPE_FORCE": 7, "LOAD_TYPE_FORM_FINDING": 8, "LOAD_TYPE_INITIAL_PRESTRESS": 9, "LOAD_TYPE_MOMENT": 10, "LOAD_TYPE_PIPE_CONTENT_FULL": 11, "LOAD_TYPE_PIPE_CONTENT_PARTIAL": 12, "LOAD_TYPE_PIPE_INTERNAL_PRESSURE": 13, "LOAD_TYPE_PRECAMBER": 14, "LOAD_TYPE_ROTARY_MOTION": 15, "LOAD_TYPE_ROTATION": 16, "LOAD_TYPE_TEMPERATURE": 17, "LOAD_TYPE_TEMPERATURE_CHANGE": 18}, selected="E_TYPE_MASS")
sheetload_4 = Number(sheetload_3)
neg = Negative(Value=sheetload_4)

# ----
# Find the folder where the Grasshopper model is stored
c_script = CSharpScript()  # -> out, A
# ---------- c_script: C# ----------
    GH_Document gh_d = owner.OnPingDocument();

    if (gh_d.IsFilePathDefined)
    {
      Print("A path is defined.");
      A = gh_d.FilePath;
    }
    else
    {
      Print("No path defined.");
    }
# ---------- end c_script ----------
split = TextSplit(Text=c_script.A, Separators="\")
lng_4 = ListLength(List=split)
expression_5 = Expression(x=lng_4, Expression="x-1")
split_2 = SplitList(List=split, Index=expression_5)  # -> ListA, ListB
join = TextJoin(Text=split_2.ListA, Join="\")  # -> flatten(Result)
pathfolder = FilePath(join)

namemodelrfem_4 = Text(namemodelrfem_3)
loadcasesrfem_4 = Data(loadcasesrfem_2)
runcalculationsrfem_4 = Boolean(runcalculationsrfem_3)
exporttocsv_4 = Boolean(exporttocsv_3)

# ----
# Run the calculation in RFEM
runcalculationsrfem_5 = Boolean(runcalculationsrfem_4)
namemodelrfem_5 = Text(namemodelrfem_4)
loadcombinationsrfem_3 = Data(loadcombinationsrfem_2)
loadcasesrfem_5 = Data(loadcasesrfem_4)
merge_7 = Merge(Data1=loadcombinationsrfem_3, Data2=loadcasesrfem_5)
rfem6_calculate = RFEM6CalculateComponent(Run=runcalculationsrfem_5, NameOfModel=namemodelrfem_5, CasesToCalculate=flatten(merge_7))  # -> Log, SuccessfulCalculation
succesfullcalculation = Boolean(rfem6_calculate.SuccessfulCalculation)

# ----
# Export results from Rfem to CSV files
namemodelrfem_6 = Text(namemodelrfem_4)
exporttocsv_5 = Boolean(exporttocsv_4)
succesfullcalculation_2 = Boolean(succesfullcalculation)
pathfolder_2 = FilePath(pathfolder)
and = GateAnd(A=exporttocsv_5, B=succesfullcalculation_2)
export_results = ExportResultsToFiles(Run=and, NameOfModel=namemodelrfem_6, PathToExportFolder=pathfolder_2, TypeOfExport="CSV")  # -> Log, SuccessfulExport

memberouterbeamsrfem_2 = Data(memberouterbeamsrfem)
memberinnerbeamsrfem_2 = Data(memberinnerbeamsrfem)

# ----
# Merge members in one list
memberinnerbeamsrfem_3 = Data(memberinnerbeamsrfem)
memberouterbeamsrfem_3 = Data(memberouterbeamsrfem)

weave_3 = Weave(Pattern=panel_13, Stream0=memberinnerbeamsrfem_3, Stream1=memberouterbeamsrfem_3, NullGaps=False)

membersrfem = Data(weave_3)

membersrfem_2 = Data(membersrfem)

membersrfem_3 = Data(membersrfem_2)
membersrfem_4 = Data(membersrfem_3)
membersrfem_5 = Data(membersrfem_3)

# ----
# Setup the loading for snow
loadcasesrfem_6 = Data(loadcasesrfem_3)
membersrfem_6 = Data(membersrfem_3)
list_8 = ValueList({"LOAD_DIRECTION_GLOBAL_X_OR_USER_DEFINED_U_PROJECTED": 0, "LOAD_DIRECTION_GLOBAL_X_OR_USER_DEFINED_U_TRUE": 1, "LOAD_DIRECTION_GLOBAL_Y_OR_USER_DEFINED_V_PROJECTED": 2, "LOAD_DIRECTION_GLOBAL_Y_OR_USER_DEFINED_V_TRUE": 3, "LOAD_DIRECTION_GLOBAL_Z_OR_USER_DEFINED_W_PROJECTED": 4, "LOAD_DIRECTION_GLOBAL_Z_OR_USER_DEFINED_W_TRUE": 5, "LOAD_DIRECTION_LOCAL_X": 6, "LOAD_DIRECTION_LOCAL_Y": 7, "LOAD_DIRECTION_LOCAL_Z": 8, "LOAD_DIRECTION_PRINCIPAL_U": 9, "LOAD_DIRECTION_PRINCIPAL_V": 10}, selected="LOAD_DIRECTION_GLOBAL_Z_OR_USER_DEFINED_W_PROJECTED")
list_9 = ValueList({"LOAD_DISTRIBUTION_CONCENTRATED_1": 0, "LOAD_DISTRIBUTION_CONCENTRATED_2": 1, "LOAD_DISTRIBUTION_CONCENTRATED_2x2": 2, "LOAD_DISTRIBUTION_CONCENTRATED_N": 3, "LOAD_DISTRIBUTION_CONCENTRATED_VARYING": 4, "LOAD_DISTRIBUTION_PARABOLIC": 5, "LOAD_DISTRIBUTION_TAPERED": 6, "LOAD_DISTRIBUTION_TRAPEZOIDAL": 7, "LOAD_DISTRIBUTION_UNIFORM": 8, "LOAD_DISTRIBUTION_UNIFORM_TOTAL": 9, "LOAD_DISTRIBUTION_VARYING": 10, "LOAD_DISTRIBUTION_VARYING_IN_Z": 11}, selected="LOAD_DISTRIBUTION_UNIFORM")
list_10 = ValueList({"E_TYPE_MASS": 0, "LOAD_TYPE_AXIAL_DISPLACEMENT": 1, "LOAD_TYPE_AXIAL_STRAIN": 2, "LOAD_TYPE_COATING_CONTOUR": 3, "LOAD_TYPE_COATING_POLYGON": 4, "LOAD_TYPE_DISPLACEMENT": 5, "LOAD_TYPE_END_PRESTRESS": 6, "LOAD_TYPE_FORCE": 7, "LOAD_TYPE_FORM_FINDING": 8, "LOAD_TYPE_INITIAL_PRESTRESS": 9, "LOAD_TYPE_MOMENT": 10, "LOAD_TYPE_PIPE_CONTENT_FULL": 11, "LOAD_TYPE_PIPE_CONTENT_PARTIAL": 12, "LOAD_TYPE_PIPE_INTERNAL_PRESSURE": 13, "LOAD_TYPE_PRECAMBER": 14, "LOAD_TYPE_ROTARY_MOTION": 15, "LOAD_TYPE_ROTATION": 16, "LOAD_TYPE_TEMPERATURE": 17, "LOAD_TYPE_TEMPERATURE_CHANGE": 18}, selected="E_TYPE_MASS")
snowload_4 = Number(snowload_3)
item_7 = ListItem(List=loadcasesrfem_6, Index="2", Wrap=True)
neg_2 = Negative(Value=snowload_4)
member_load = MemberLoad(
    LoadCaseNo=item_7,
    MembersNo=membersrfem_6,
    LoadType=list_10,
    LoadDistribution=list_9,
    CoordinateSystem="1",
    LoadDirection=list_8,
    LoadMagnitudeP=neg_2,
    mode="Assemble")
loadsnownegativerfem = Data(member_load)

loadsnownegativerfem_2 = Data(loadsnownegativerfem)
membersrfem_7 = Data(membersrfem_3)

# ----
# Setup the loading for negative wind loading
loadcasesrfem_7 = Data(loadcasesrfem_3)
windloading_4 = Number(windloading_3)
list_11 = ValueList({"LOAD_DIRECTION_GLOBAL_X_OR_USER_DEFINED_U_PROJECTED": 0, "LOAD_DIRECTION_GLOBAL_X_OR_USER_DEFINED_U_TRUE": 1, "LOAD_DIRECTION_GLOBAL_Y_OR_USER_DEFINED_V_PROJECTED": 2, "LOAD_DIRECTION_GLOBAL_Y_OR_USER_DEFINED_V_TRUE": 3, "LOAD_DIRECTION_GLOBAL_Z_OR_USER_DEFINED_W_PROJECTED": 4, "LOAD_DIRECTION_GLOBAL_Z_OR_USER_DEFINED_W_TRUE": 5, "LOAD_DIRECTION_LOCAL_X": 6, "LOAD_DIRECTION_LOCAL_Y": 7, "LOAD_DIRECTION_LOCAL_Z": 8, "LOAD_DIRECTION_PRINCIPAL_U": 9, "LOAD_DIRECTION_PRINCIPAL_V": 10}, selected="LOAD_DIRECTION_LOCAL_Z")
list_12 = ValueList({"LOAD_DISTRIBUTION_CONCENTRATED_1": 0, "LOAD_DISTRIBUTION_CONCENTRATED_2": 1, "LOAD_DISTRIBUTION_CONCENTRATED_2x2": 2, "LOAD_DISTRIBUTION_CONCENTRATED_N": 3, "LOAD_DISTRIBUTION_CONCENTRATED_VARYING": 4, "LOAD_DISTRIBUTION_PARABOLIC": 5, "LOAD_DISTRIBUTION_TAPERED": 6, "LOAD_DISTRIBUTION_TRAPEZOIDAL": 7, "LOAD_DISTRIBUTION_UNIFORM": 8, "LOAD_DISTRIBUTION_UNIFORM_TOTAL": 9, "LOAD_DISTRIBUTION_VARYING": 10, "LOAD_DISTRIBUTION_VARYING_IN_Z": 11}, selected="LOAD_DISTRIBUTION_UNIFORM")
item_8 = ListItem(List=loadcasesrfem_7, Index="1", Wrap=True)

neg_3 = Negative(Value=windloading_4)

# ----
# Find the index of the surfaces
outerlines_9 = Curve(outerlines_8)
number_slider_3 = Slider(0.097, range=0..1)
Z_3 = UnitZ(Factor=number_slider_3)

lng_5 = ListLength(List=outerlines_9)
weave_4 = Weave(Pattern=panel_31, Stream0=innerlines_9, Stream1=outerlines_9, NullGaps=False)
division = Division(A=lng_3, B=lng_5)
midpt_4 = CurveMiddle(Curve=weave_4)

lng_6 = ListLength(List=weave_4)
division_2 = Division(A=lng_6, B=2)
round = Round(Number=division_2)  # -> Nearest, Floor, Ceiling
series_3 = Series(Start=0, Step=1, Count=round.Nearest)
series_4 = Series(Start=round.Nearest, Step=1, Count=round.Floor)
move_3 = Move(Geometry=midpt_4, Motion=Z_3)  # -> Geometry, Transform
seriesmemberspositive = Data(series_3)
countmembersnegative = Data(series_4)
points = PointList(Points=move_3.Geometry, Size=number_slider_3)

seriesmemberspositive_2 = Data(seriesmemberspositive)
countmembersnegative_2 = Data(countmembersnegative)
item_9 = ListItem(List=membersrfem_4, Index=countmembersnegative_2, Wrap=True)
item_10 = ListItem(List=membersrfem_5, Index=seriesmemberspositive_2, Wrap=True)
ratioinnerouter = Panel(division)
member_load_2 = MemberLoad(
    LoadCaseNo=item_8,
    MembersNo=item_9,
    LoadType=list_6,
    LoadDistribution=list_12,
    CoordinateSystem="1",
    LoadDirection=list_11,
    LoadMagnitudeP=neg_3,
    mode="Assemble")

loadwindnegativerfem = Data(member_load_2)

# ----
# Setup the loading for positive wind loading
loadcasesrfem_8 = Data(loadcasesrfem_3)
windloading_5 = Number(windloading_3)
list_13 = ValueList({"LOAD_DIRECTION_GLOBAL_X_OR_USER_DEFINED_U_PROJECTED": 0, "LOAD_DIRECTION_GLOBAL_X_OR_USER_DEFINED_U_TRUE": 1, "LOAD_DIRECTION_GLOBAL_Y_OR_USER_DEFINED_V_PROJECTED": 2, "LOAD_DIRECTION_GLOBAL_Y_OR_USER_DEFINED_V_TRUE": 3, "LOAD_DIRECTION_GLOBAL_Z_OR_USER_DEFINED_W_PROJECTED": 4, "LOAD_DIRECTION_GLOBAL_Z_OR_USER_DEFINED_W_TRUE": 5, "LOAD_DIRECTION_LOCAL_X": 6, "LOAD_DIRECTION_LOCAL_Y": 7, "LOAD_DIRECTION_LOCAL_Z": 8, "LOAD_DIRECTION_PRINCIPAL_U": 9, "LOAD_DIRECTION_PRINCIPAL_V": 10}, selected="LOAD_DIRECTION_LOCAL_Z")
list_14 = ValueList({"LOAD_DISTRIBUTION_CONCENTRATED_1": 0, "LOAD_DISTRIBUTION_CONCENTRATED_2": 1, "LOAD_DISTRIBUTION_CONCENTRATED_2x2": 2, "LOAD_DISTRIBUTION_CONCENTRATED_N": 3, "LOAD_DISTRIBUTION_CONCENTRATED_VARYING": 4, "LOAD_DISTRIBUTION_PARABOLIC": 5, "LOAD_DISTRIBUTION_TAPERED": 6, "LOAD_DISTRIBUTION_TRAPEZOIDAL": 7, "LOAD_DISTRIBUTION_UNIFORM": 8, "LOAD_DISTRIBUTION_UNIFORM_TOTAL": 9, "LOAD_DISTRIBUTION_VARYING": 10, "LOAD_DISTRIBUTION_VARYING_IN_Z": 11}, selected="LOAD_DISTRIBUTION_UNIFORM")
item_11 = ListItem(List=loadcasesrfem_8, Index="1", Wrap=True)

member_load_3 = MemberLoad(
    LoadCaseNo=item_11,
    MembersNo=item_10,
    LoadType=list_7,
    LoadDistribution=list_14,
    CoordinateSystem="1",
    LoadDirection=list_13,
    LoadMagnitudeP=windloading_5,
    mode="Assemble")

loadwindpositiverfem = Data(member_load_3)

loadwindpositiverfem_2 = Data(loadwindpositiverfem)

# ----
# Setup the loading for positive wind loading
loadcasesrfem_9 = Data(loadcasesrfem_3)
list_15 = ValueList({"LOAD_DIRECTION_GLOBAL_X_OR_USER_DEFINED_U_PROJECTED": 0, "LOAD_DIRECTION_GLOBAL_X_OR_USER_DEFINED_U_TRUE": 1, "LOAD_DIRECTION_GLOBAL_Y_OR_USER_DEFINED_V_PROJECTED": 2, "LOAD_DIRECTION_GLOBAL_Y_OR_USER_DEFINED_V_TRUE": 3, "LOAD_DIRECTION_GLOBAL_Z_OR_USER_DEFINED_W_PROJECTED": 4, "LOAD_DIRECTION_GLOBAL_Z_OR_USER_DEFINED_W_TRUE": 5, "LOAD_DIRECTION_LOCAL_X": 6, "LOAD_DIRECTION_LOCAL_Y": 7, "LOAD_DIRECTION_LOCAL_Z": 8, "LOAD_DIRECTION_PRINCIPAL_U": 9, "LOAD_DIRECTION_PRINCIPAL_V": 10}, selected="LOAD_DIRECTION_GLOBAL_Z_OR_USER_DEFINED_W_TRUE")
list_16 = ValueList({"LOAD_DISTRIBUTION_CONCENTRATED_1": 0, "LOAD_DISTRIBUTION_CONCENTRATED_2": 1, "LOAD_DISTRIBUTION_CONCENTRATED_2x2": 2, "LOAD_DISTRIBUTION_CONCENTRATED_N": 3, "LOAD_DISTRIBUTION_CONCENTRATED_VARYING": 4, "LOAD_DISTRIBUTION_PARABOLIC": 5, "LOAD_DISTRIBUTION_TAPERED": 6, "LOAD_DISTRIBUTION_TRAPEZOIDAL": 7, "LOAD_DISTRIBUTION_UNIFORM": 8, "LOAD_DISTRIBUTION_UNIFORM_TOTAL": 9, "LOAD_DISTRIBUTION_VARYING": 10, "LOAD_DISTRIBUTION_VARYING_IN_Z": 11}, selected="LOAD_DISTRIBUTION_UNIFORM")
item_12 = ListItem(List=loadcasesrfem_9, Index="0", Wrap=True)

member_load_4 = MemberLoad(
    LoadCaseNo=item_12,
    MembersNo=membersrfem_7,
    LoadType=list_5,
    LoadDistribution=list_16,
    CoordinateSystem="1",
    LoadDirection=list_15,
    LoadMagnitudeP=neg,
    mode="Assemble")

loadsheetsrfem = Data(member_load_4)

loadsheetsrfem_2 = Data(loadsheetsrfem)

# ----
# Merge all the loads
loadwindnegativerfem_2 = Data(loadwindnegativerfem)
merge_8 = Merge(Data1=loadsheetsrfem_2, Data2=loadwindpositiverfem_2, Data3=loadwindnegativerfem_2, Data4=loadsnownegativerfem_2)
loadsrfem = Data(merge_8)

loadsrfem_2 = Data(loadsrfem)

exporttorfem_3 = Boolean(exporttorfem_2)
sectionsrfem_4 = Data(sectionrfem_2)
namemodelrfem_7 = Text(namemodelrfem_3)
supportsrfem_3 = Data(supportsrfem_2)
analysissettingsrfem_9 = Data(analysissettingsrfem_2)
designsituationrfem_3 = Data(designsituationrfem_2)
loadcombinationsrfem_4 = Data(loadcombinationsrfem_2)
loadcasesrfem_10 = Data(loadcasesrfem_2)
loadsrfem_3 = Data(loadsrfem_2)
materialsrfem_3 = Data(materialsrfem_2)
membersrfem_8 = Data(membersrfem_2)

panel_36 = Panel("Export to RFEM")
membersrfem_9 = Data(membersrfem_8)
supportsrfem_4 = Data(supportsrfem_3)
exporttorfem_4 = Boolean(exporttorfem_3)
materialsrfem_4 = Data(materialsrfem_3)
sectionsrfem_5 = Data(sectionsrfem_4)
analysissettingsrfem_10 = Data(analysissettingsrfem_9)
designsituationrfem_4 = Data(designsituationrfem_3)
loadcombinationsrfem_5 = Data(loadcombinationsrfem_4)
loadcasesrfem_11 = Data(loadcasesrfem_10)
namemodelrfem_8 = Text(namemodelrfem_7)
loadsrfem_4 = Data(loadsrfem_3)
list_17 = ValueList({"None": 0, "Microns": 1, "Millimeters": 2, "Centimeters": 3, "Meters": 4, "Kilometers": 5, "Microinches": 6, "Mils": 7, "Inches": 8, "Feet": 9, "Miles": 10, "CustomUnits": 11, "Angstroms": 12, "Nanometers": 13, "Decimeters": 14, "Dekameters": 15, "Hectometers": 16, "Megameters": 17, "Gigameters": 18, "Yards": 19, "PrinterPoints": 20, "PrinterPicas": 21, "NauticalMiles": 22, "AstronomicalUnits": 23, "LightYears": 24, "Parsecs": 25, "Unset": 26}, selected="Meters")
toggle = BooleanToggle(True)
merge_9 = Merge(
    Data1=materialsrfem_4,
    Data2=membersrfem_9,
    Data3=sectionsrfem_5,
    Data4=supportsrfem_4,
    Data5=analysissettingsrfem_10,
    Data6=designsituationrfem_4,
    Data7=loadcombinationsrfem_5,
    Data8=loadcasesrfem_11,
    Data9=loadsrfem_4)
rfem_export = RFEM6ExportComponent(Run=exporttorfem_4, Input=flatten(merge_9))  # -> RFEMData, Log, SuccessfulExport
